# Grasshopper definition FloorPainting.gh (Grasshopper 1.0.7)
# plug-ins: Robots, Anemone, LunchBox

list = ValueList({"AA-KR60", "AA-KR30", "AA-KR60_KR30", "AARCH IRB120", "AARCH IRB6620", "Bartlett-IRB120", "Bartlett-IRB1600", "Bartlett-KR6", "Bartlett-KR60", "Bartlett-UR10"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}, selected="iaac-KR150-2_110")
panel = Panel("ws://192.168.11.237:9090")
panel_2 = Panel("ws://172.16.21.221:9090")
load_robot = LoadRobotSystem(Name=list, Base=PlaneXY(0, 0, 0))
# topic name must be the same as the one defined in the ros python script as topic name
# IP ADDRESS OF RASPBERRYPI
panel_3 = Panel("ws://192.168.11.235:9090")
ros_topic_types = ROSTopicTypes({"String": "std_msgs/String", "Twist": "geometry_msgs/Twist", "Pose": "geometry_msgs/Pose"}, selected="Twist")
button = Button()

websocket_client_start = WebsocketClientStart(Address=panel_3, InitalMessage="Hello World", Reset=button)  # disabled
panel_4 = Panel("/distance_to_obstacle")  # disabled
toggle = BooleanToggle(True)  # disabled
subscribe = Subscribe(Topic=panel_4)  # -> R; disabled
# ---------- subscribe: Python ----------
import json


data = {
"op":"subscribe",
"topic":Topic
}

R = json.dumps(data)
# ---------- end subscribe ----------
websocket_client_sender = WebsocketClientSender(WebsocketObjects=websocket_client_start, Message=subscribe)  # disabled
websocket_client_receiver = WebsocketClientReceiver(WebsocketObjects=websocket_client_start, AutoUpdate=toggle)  # -> Message, Status; disabled
panel_5 = Panel(websocket_client_receiver.Message)  # disabled
python = GhPythonScript(M=panel_5)  # -> out; disabled
# ---------- python: Python ----------
import json

try:
    jsonObj = json.loads(M)["msg"]
    print(jsonObj["data"])

    a = jsonObj["data"]

except:
    X = None
# ---------- end python ----------
panel_6 = Panel(python)  # disabled

# ---- group: BOUNDARY OF SPCE
websocket_client_start_2 = WebsocketClientStart(Address=panel_3, InitalMessage="Hello World", Reset=button)
subscribe_2 = Subscribe(Topic="/newcoord")  # -> R; same code as subscribe
websocket_client_sender_2 = WebsocketClientSender(WebsocketObjects=websocket_client_start_2, Message=subscribe_2)
timer = Timer(TimerInterval=1000, Target=websocket_client_receiver_2)
websocket_client_receiver_2 = WebsocketClientReceiver(WebsocketObjects=websocket_client_start_2, AutoUpdate=Toggle(False))  # -> Message, Status
python_2 = GhPythonScript(M=websocket_client_receiver_2.Message)  # -> out; same code as python
data = Data(python_2)
rep = ReplaceText(Text=data, Find="[", RecursiveReplace=False)
rep_2 = ReplaceText(Text=rep, Find="]", RecursiveReplace=False)
split = TextSplit(Text=rep_2, Separators=",")
num = Number(split)
partition = PartitionList(List=num, Size="2")
item = ListItem(List=partition, Index=0, Wrap=True)  # -> Item, Item1
pt = ConstructPoint(XCoordinate=item.Item, YCoordinate=item.Item1, ZCoordinate=0)  # -> flatten(Point)

# ----
timer_2 = Timer(TimerInterval=1000, Target=websocket_client_start_3)
websocket_client_start_3 = WebsocketClientStart(Address=panel_3, InitalMessage="Hello World", Reset=button)
advertise = Advertise(Topic="/gh", Type=ros_topic_types)  # -> R
# ---------- advertise: Python ----------
import json


data = {
"op":"advertise",
"topic":Topic,
"type":Type
}

R = json.dumps(data)
# ---------- end advertise ----------
websocket_client_sender_3 = WebsocketClientSender(WebsocketObjects=websocket_client_start_3, Message=advertise)
panel_7 = Panel(websocket_client_start_3)
data_2 = Data("{\"topic\": \"/pose_Tracker\", \"msg\": {\"position\": {\"y\": 0.0011513233184814453, \"x\": 1.0523889064788818, \"z\": 0.731367826461792}, \"orientation\": {\"y\": 0.6496021151542664, \"x\": -0.28966018557548523, \"z\": 0.6410505175590515, \"w\": 0.2883891761302948}}, \"op\": \"publish\"}")  # disabled
pline = PolyLine(Vertices=pt, Closed=invert(False))
crv = Curve(pline)

# ---- group: INPUT CURVES HERE
crv_2 = Curve(<curve referenced from the Rhino model>)

# ----
explode = Explode(Curve=crv_2, Recursive=True)  # -> Segments, Vertices
number_slider = Slider(1000, range=0..1000)
target = Point(explode.Vertices)

# ---- group: rotation speed multiplier
number_slider_2 = Slider(0.21, range=0..1)

# ---- group: speed multiplier
number_slider_3 = Slider(0.039, range=0..1)

# ----
# parsing data from /odom to receive only the orientation and rotation
# reading /odom topic from ros
panel_8 = Panel("/odom")
subscribe_3 = Subscribe(Topic=panel_8)  # -> R, R2
# ---------- subscribe_3: Python ----------
import json


data = {
"op":"subscribe",
"topic":Topic
}



R = json.dumps(data)
# ---------- end subscribe_3 ----------
timer_3 = Timer(TimerInterval=500, Target=websocket_client_receiver_3)
websocket_client_receiver_3 = WebsocketClientReceiver(WebsocketObjects=websocket_client_start_3, AutoUpdate=Toggle(True))  # -> Message, Status
websocket_client_sender_4 = WebsocketClientSender(WebsocketObjects=websocket_client_start_3, Message=subscribe_3.R)
panel_9 = Panel(websocket_client_receiver_3.Message)
python_3 = GhPythonScript(M=websocket_client_receiver_3.Message)  # -> out, X, Y, Z, q1, q2, q3, q4
# ---------- python_3: Python ----------
import json

try:
    jsonObj = json.loads(M)["msg"]

    X = jsonObj["pose"]["pose"]["position"]["x"]
    Y = jsonObj["pose"]["pose"]["position"]["y"]
    Z = jsonObj["pose"]["pose"]["position"]["z"]
    
    q1 = jsonObj["pose"]["pose"]["orientation"]["w"]
    q2 = jsonObj["pose"]["pose"]["orientation"]["x"]
    q3 = jsonObj["pose"]["pose"]["orientation"]["y"]
    q4 = jsonObj["pose"]["pose"]["orientation"]["z"]
except:
    X = None
    Y = None
    Z = None
    
    q1 = None
    q2 = None
    q3 = None
    q4 = None
# ---------- end python_3 ----------
quat2trans = QuaternionToTransform(x=python_3.q1, y=python_3.q2, z=python_3.q3, w=python_3.q4)  # -> m
# ---------- quat2trans: Python ----------
from Grasshopper.Kernel.Types import GH_Matrix
from Rhino.Geometry import Transform

m = Transform()

x = (x or 1)
y = (y or 0)
z = (z or 0)
w = (w or 0)

xx2 = 2 * x * x
yy2 = 2 * y * y
zz2 = 2 * z * z
xy2 = 2 * x * y
wz2 = 2 * w * z
zx2 = 2 * z * x
wy2 = 2 * w * y
yz2 = 2 * y * z
wx2 = 2 * w * x



m.M00 = 1. - yy2 - zz2
m.M01 = xy2 - wz2
m.M02 = zx2 + wy2
m.M03 = 0

m.M10 = xy2 + wz2
m.M11 = 1. - xx2 - zz2
m.M12 = yz2 - wx2
m.M13 = 0

m.M20 = zx2 - wy2
m.M21 = yz2 + wx2
m.M22 = 1. - xx2 - yy2
m.M23 = 0

m.M30 = 0
m.M31 = 0
m.M32 = 0
m.M33 = 0
# ---------- end quat2trans ----------
pt_2 = ConstructPoint(XCoordinate=python_3.X, YCoordinate=python_3.Y, ZCoordinate=0)
xy = XYPlane(Origin=Point(0, 0, 0))
transform = Transform(Geometry=xy, Transform=quat2trans)
move = Move(Geometry=transform, Motion=pt_2)  # -> Geometry, Transform
yz = YZPlane(Origin=Point(0, 0, 0))
deplane = DeconstructPlane(Plane=move.Geometry)  # -> Origin, XAxis, YAxis, ZAxis
Y = UnitY(Factor=1)
pflip = FlipPlane(Plane=yz, ReverseX=False, ReverseY=False, SwapAxes=True)
angle = Angle(VectorA=deplane.YAxis, VectorB=Y, Plane=pflip)  # -> Angle, Reflex
Z = UnitZ(Factor="1")
neg = Negative(Value=angle.Angle)
panel_10 = Panel(angle.Angle)
vrot = Rotate(Vector=Y, Axis=Z, Angle=neg)
rev = Reverse(Vector=vrot)
vrot_2 = Rotate(Vector=vrot, Axis=Z, Angle="Pi/2")

# ----
# seeing robot x,y,z
# location in rhino space
pl = ConstructPlane(Origin=move.Geometry, XAxis=vrot_2, YAxis=rev)

# ---- group: OFFSET OF BOUNDARY
xy_2 = XYPlane(Origin=Point(0, 0, 0))  # disabled
number_slider_4 = Slider(50, range=0..100)  # disabled
orient = Orient(Geometry=pt, Source=xy_2, Target=pl)  # -> Geometry, Transform; disabled
lng = ListLength(List=orient.Geometry)  # disabled
range = Range(Domain=lng, Steps=number_slider_4)  # disabled
item_2 = ListItem(List=orient.Geometry, Index=range, Wrap=True)  # disabled
number_slider_5 = Slider(-0.155, range=-1..1)  # disabled
pline_2 = PolyLine(Vertices=item_2, Closed=invert(False))  # disabled
offset = OffsetCurve(Curve=pline_2, Distance=number_slider_5, Plane=PlaneXY(0, 0, 0), Corners=1)  # disabled

# ----
cluster = Cluster(G=pl, P=pl)

# ----
# connect 'current' to plane component
# in order to send new points to robot
current = Plane(pl)
dam = DataDam(DataA=current, BufferDelay=10000000, BufferMode=0)
loop_start = LoopStart(N=Slider(10235, range=0..100000), D0=dam, D1="0")  # -> port, Counter, Data, Data_2, Data_3
pln = Plane(current)
panel_11 = Panel(loop_start.Data_2)
panel_12 = Panel(loop_start.Counter)
item_3 = ListItem(List=target, Index=loop_start.Data_2, Wrap=invert(True))
pt_3 = Point(pln)

# ----
# turn into planes
pln_2 = Plane(pln)
xy_3 = XYPlane(Origin=Point(0, 0, 0))
vec2pt = Vector2Pt(PointA=pt_3, PointB=item_3, Unitize=False)  # -> Vector, Length
deplane_2 = DeconstructPlane(Plane=pln_2)  # -> Origin, XAxis, YAxis, ZAxis
pflip_2 = FlipPlane(Plane=xy_3, ReverseX=False, ReverseY=False, SwapAxes=True)

# ----
# the rotation value is adjusted
# so that it can rotate left and right
angle_2 = Angle(VectorA=deplane_2.XAxis, VectorB=vec2pt.Vector, Plane=pflip_2)  # -> Angle, Reflex
deg = Degrees(Radians=angle_2.Angle)
expression = Expression(x=deg, Expression="if(x>180, x-360, x)")

# ---- group: if true, fix rotation first
abs = Absolute(Value=expression)
larger = LargerThan(FirstNumber=abs, SecondNumber=Slider(8, range=0..10))  # -> LargerThan, OrEqualTo

# ----
panel_13 = Panel(expression)
neg_2 = Negative(Value=expression)
current_2 = Point(pt_3)
target_2 = Point(item_3)
abs_2 = Absolute(Value=neg_2)
filter = StreamFilter(Gate=larger.LargerThan, Stream0=target_2, Stream1=current_2)
division = Division(A=neg_2, B=abs_2)

# ----
# move to the next point in index
dist = Distance(PointA=pt_3, PointB=item_3)
smaller = SmallerThan(FirstNumber=dist, SecondNumber=Slider(0.03, range=0..0.1))  # -> SmallerThan, OrEqualTo
filter_2 = StreamFilter(Gate=smaller.SmallerThan, Stream0="0", Stream1="1")
addition = Addition(A=loop_start.Data_2, B=filter_2)

pdecon = Deconstruct(Point=current_2)  # -> XComponent, YComponent, ZComponent
pdecon_2 = Deconstruct(Point=filter)  # -> XComponent, YComponent, ZComponent
multiplication = Multiplication(A=division, B=number_slider_2)
subtraction = Subtraction(A=pdecon_2.YComponent, B=pdecon.YComponent)
subtraction_2 = Subtraction(A=pdecon_2.XComponent, B=pdecon.XComponent)
rotate = Rotate(Geometry=pln_2, Angle=multiplication, Plane=pln_2)  # -> Geometry, Transform
panel_14 = Panel(multiplication)
vec = VectorXYZ(XComponent=subtraction_2, YComponent=subtraction, ZComponent=0)  # -> Vector, Length

# ----
# view point of robot based on the directions we send
relative = RelativeCoordinates(Plane=pln, Point=pt_3)  # -> RelativePoint, RelativeX, RelativeY, RelativeZ
relative_2 = RelativeCoordinates(Plane=pln, Point=filter)  # -> RelativePoint, RelativeX, RelativeY, RelativeZ
subtraction_3 = Subtraction(A=relative_2.RelativeX, B=relative.RelativeX)
vec_2 = VectorXYZ(XComponent=subtraction_3, YComponent=0, ZComponent=0)  # -> Vector, Length
unit = UnitVector(Vector=vec_2.Vector)
devec = DeconstructVector(Vector=unit)  # -> XComponent, YComponent, ZComponent
multiplication_2 = Multiplication(A=devec.XComponent, B=number_slider_3)
X = UnitX(Factor=multiplication_2)
move_2 = Move(Geometry=relative.RelativePoint, Motion=X)  # -> Geometry, Transform

# ----
# sending to robot
number_slider_6 = Slider(0, range=-0.1..0.1)
number_slider_7 = Slider(0, range=-1..1)
pt_4 = ConstructPoint(XCoordinate=multiplication_2, YCoordinate=0, ZCoordinate=0)
xy_4 = XYPlane(Origin=pt_4)
rotate_2 = Rotate(Geometry=xy_4, Angle=degrees(multiplication), Plane=xy_4)  # -> Geometry, Transform
fromplane = FromPlane(Plane=rotate_2.Geometry, RobotSystem=load_robot)
item_4 = ListItem(List=fromplane, Index=0, Wrap=True)  # -> Item, Item1, Item2, Item3, Item4, Item5
publish_twist = PublishTwist(topic="/gh", LX=item_4.Item, LY=item_4.Item1, LZ=item_4.Item2, AX=item_4.Item5, AY=item_4.Item4, AZ=item_4.Item3)  # -> R
# ---------- publish_twist: Python ----------
import json


data = {
"op":"publish",
"topic":topic,
"msg":{
    "angular":{"x":(AX or 0), "y":(AY or 0), "z":(AZ or 0)},
    "linear":{"x":(LX or 0), "y":(LY or 0), "z":(LZ or 0)},
}
}

R = json.dumps(data)
# ---------- end publish_twist ----------
websocket_client_sender_5 = WebsocketClientSender(WebsocketObjects=websocket_client_start_3, Message=publish_twist)

unit_2 = UnitVector(Vector=vec.Vector)
devec_2 = DeconstructVector(Vector=unit_2)  # -> XComponent, YComponent, ZComponent
multiplication_3 = Multiplication(A=devec_2.XComponent, B=number_slider_3)
multiplication_4 = Multiplication(A=devec_2.YComponent, B=number_slider_3)
addition_2 = Addition(A=pdecon.XComponent, B=multiplication_3)
addition_3 = Addition(A=pdecon.YComponent, B=multiplication_4)

# ----
# to stop the loop
null = NullItem(Item=item_3)  # -> NullFlags, InvalidFlags, Description

panel_15 = Panel(addition_2)
pt_5 = ConstructPoint(XCoordinate=addition_2, YCoordinate=addition_3, ZCoordinate=0)
pl_origin = PlaneOrigin(Base=rotate.Geometry, Origin=pt_5)
running = Running(
    port=loop_start.port,
    Exit=null.NullFlags,
    Data=pl_origin,
    Data_2=addition,
    Data_3=move_2.Geometry,
    TimeOutVal=0,
    pausedState=False,
    state="Constant output")  # -> D0, D1, D2

# ==== cluster Cluster
P = ClusterInput()
deg = Degrees(Radians=Slider(8.131, range=0..90))
G = ClusterInput()
deplane = DeconstructPlane(Plane=P)  # -> Origin, XAxis, YAxis, ZAxis
rotate = Rotate(Geometry=G, Angle=deg, Plane=deplane.Origin)  # -> Geometry, Transform
