# Grasshopper definition send topic to ROS.gh (Grasshopper 1.0.7)
# plug-ins: Robots

list = ValueList({"AA-KR60", "AA-KR30", "AA-KR60_KR30", "AARCH IRB120", "AARCH IRB6620", "Bartlett-IRB120", "Bartlett-IRB1600", "Bartlett-KR6", "Bartlett-KR60", "Bartlett-UR10"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}, selected="iaac-KR150-2_110")
panel = Panel("ws://192.168.11.237:9090")
# topic name must be the same as the one defined in the ros python script as topic name
panel_2 = Panel("/gh")
ros_topic_types = ROSTopicTypes({"String": "std_msgs/String", "Twist": "geometry_msgs/Twist", "Pose": "geometry_msgs/Pose"}, selected="Twist")
pt = ConstructPoint(XCoordinate=Slider(-0.04, range=-0.1..0.1), YCoordinate=0, ZCoordinate=0)
number_slider = Slider(22, range=-90..90)
load_robot = LoadRobotSystem(Name=list, Base=PlaneXY(0, 0, 0))
xy = XYPlane(Origin=pt)
# SENDING TOPIC TO ROS
panel_3 = Panel("/odom")
timer = Timer(TimerInterval=10000, Target=websocket_client_start)
rotate = Rotate(Geometry=xy, Angle=degrees(Slider(0.72, range=-1..1)), Plane=xy)  # -> Geometry, Transform
websocket_client_start = WebsocketClientStart(Address="ws://192.168.11.235:9090", InitalMessage="Hello World", Reset=Button())
subscribe = Subscribe(Topic=panel_3)  # -> R
# ---------- subscribe: Python ----------
import json


data = {
"op":"subscribe",
"topic":Topic
}

R = json.dumps(data)
# ---------- end subscribe ----------
fromplane = FromPlane(Plane=xy, RobotSystem=load_robot)
websocket_client_receiver = WebsocketClientReceiver(WebsocketObjects=websocket_client_start, AutoUpdate=True)  # -> Message, Status
websocket_client_sender = WebsocketClientSender(WebsocketObjects=websocket_client_start, Message=subscribe)
advertise = Advertise(Topic=panel_2, Type=ros_topic_types)  # -> R
# ---------- advertise: Python ----------
import json


data = {
"op":"advertise",
"topic":Topic,
"type":Type
}

R = json.dumps(data)
# ---------- end advertise ----------
item = ListItem(List=fromplane, Index=0, Wrap=True)  # -> Item, Item1, Item2, Item3, Item4, Item5
panel_4 = Panel(websocket_client_receiver.Message)
panel_5 = Panel(websocket_client_start)
publish_twist = PublishTwist(topic=panel_2, LX=item.Item, LY=item.Item1, LZ=item.Item2, AX=item.Item3, AY=item.Item4, AZ=item.Item5)  # -> R
# ---------- publish_twist: Python ----------
import json


data = {
"op":"publish",
"topic":topic,
"msg":{
    "angular":{"x":(AX or 0), "y":(AY or 0), "z":(AZ or 0)},
    "linear":{"x":(LX or 0), "y":(LY or 0), "z":(LZ or 0)},
}
}

R = json.dumps(data)
# ---------- end publish_twist ----------
websocket_client_sender_2 = WebsocketClientSender(WebsocketObjects=websocket_client_start, Message=advertise)
websocket_client_sender_3 = WebsocketClientSender(WebsocketObjects=websocket_client_start, Message=publish_twist)
python = GhPythonScript(M=panel_4)  # -> out, X, Y, Z, q1, q2, q3, q4
# ---------- python: Python ----------
import json

try:
    jsonObj = json.loads(M)["msg"];
    
    X = jsonObj["position"]["x"]
    Y = jsonObj["position"]["y"]
    Z = jsonObj["position"]["z"]
    
    q1 = jsonObj["orientation"]["x"]
    q2 = jsonObj["orientation"]["y"]
    q3 = jsonObj["orientation"]["z"]
    q4 = jsonObj["orientation"]["w"]
except:
    X = None
    Y = None
    Z = None
    
    q1 = None
    q2 = None
    q3 = None
    q4 = None
# ---------- end python ----------
quat2trans = QuaternionToTransform(x=python.q1, y=python.q2, z=python.q3, w=python.q4)  # -> m
# ---------- quat2trans: Python ----------
from Grasshopper.Kernel.Types import GH_Matrix
from Rhino.Geometry import Transform

m = Transform()

x = (x or 1)
y = (y or 0)
z = (z or 0)
w = (w or 0)

xx2 = 2 * x * x
yy2 = 2 * y * y
zz2 = 2 * z * z
xy2 = 2 * x * y
wz2 = 2 * w * z
zx2 = 2 * z * x
wy2 = 2 * w * y
yz2 = 2 * y * z
wx2 = 2 * w * x



m.M00 = 1. - yy2 - zz2
m.M01 = xy2 - wz2
m.M02 = zx2 + wy2
m.M03 = 0

m.M10 = xy2 + wz2
m.M11 = 1. - xx2 - zz2
m.M12 = yz2 - wx2
m.M13 = 0

m.M20 = zx2 - wy2
m.M21 = yz2 + wx2
m.M22 = 1. - xx2 - yy2
m.M23 = 0

m.M30 = 0
m.M31 = 0
m.M32 = 0
m.M33 = 0
# ---------- end quat2trans ----------
pt_2 = ConstructPoint(XCoordinate=python.X, YCoordinate=python.Y, ZCoordinate=0)
xy_2 = XYPlane(Origin=Point(0, 0, 0))
transform = Transform(Geometry=xy_2, Transform=quat2trans)
move = Move(Geometry=transform, Motion=pt_2)  # -> Geometry, Transform
